# Requirement set REQ_Plotter2D (R2024b)

## 1 [SEC-PHY] 1. Physical Constraints (Container)
physical constraint that limit the plotter

### 1.1 [REQ-SYS-PHY-001] Workspace Dimensions
The system shall provide a usable workspace of at least 200 mm on the X-axis and 200 mm on the Y-axis.

### 1.2 [REQ-SYS-PHY-002] Boundary Protection
The controller shall never command a position outside the range [0, 200] mm for both axes.

## 2 [SEC-FUN] 2. Functional Logic (Container)
define the logic of the system, its stateflow, switch mode system and answers to the user

### 2.1 [REQ-SYS-FUN-001] ON/OFF Input
The system shall accept a binary input signal "System_ON".

### 2.2 [REQ-SYS-FUN-002] OFF Behavior
If the "System_ON" signal is FALSE, the commanded velocity for both axes shall be forced to 0.

### 2.3 [REQ-SYS-FUN-003] Operating Modes
The system shall implement a state machine containing at least the following states: Idle, Drawing, and Error.

### 2.4 [REQ-SYS-FUN-004] Start Transition
A transition from Idle to Drawing shall occur upon reception of the "Evt_Start" event.

### 2.5 [REQ-SYS-FUN-005] Shape Generation
In the Drawing mode, the system shall generate X(t) and Y(t) trajectories corresponding to the selected shape (Segment or Square).

## 3 [SEC-SAF] 3. Safety (Container)
security requirements, how and when to stop for exemple

### 3.1 [REQ-SYS-SAF-001] Emergency Stop
Activation of the "Emergency_Stop" signal shall trigger an immediate transition to the Error state and stop all motor commands.

## 4 [SEC-PERF] 4. Performance
Quantitative performance metrics we expect from the system.

### 4.1 [REQ-SYS-PERF-001] Cycle Time
The system shall complete the tracing of a 100 x 100 mm square in less than 10 seconds.

### 4.2 [REQ-SYS-PERF-002] Dynamic Limiting
The commanded acceleration shall not exceed 500 mm/s² to prevent actuator saturation.